# Dynamo graph auto-column-placement.dyn (Dynamo 2.18.1.5096)

family_types = FamilyTypes("Columns_Rectangular:600x600mm")
levels = Levels("Level 0")
byPointAndLevel = FamilyInstance.ByPointAndLevel(familyType=family_types, level=levels)  # unwired: point
categories = Categories("OST_Grids")
all_elements_of_category = ElementsOfCategory(Category=categories)
curve = Grid.Curve(grid=all_elements_of_category)
intersect = Geometry.Intersect(geometry=curve, other=curve)
filterByBoolMask = List.FilterByBoolMask()  # unwired: list, mask
